# Grasshopper definition Mesh Subsect_20190305.gh (Grasshopper 1.0.7)

# ----
# Get/ Toggle Subset of Object Using Bbox and Grid sytem
# z-dir contours
# Mesh Bounding Box Contours
# y-dir contours
mesh = Mesh(<mesh referenced from the Rhino model>)
bbox = BoundingBox(Content=mesh, Plane=PlaneXY(0, 0, 0))  # -> Box, Box_2
brep = Brep(bbox.Box_2)
debrep = DeconstructBrep(Brep=brep)  # -> Faces, Edges, Vertices
crv = Curve(debrep.Edges)
item = ListItem(List=crv, Index=0, Wrap=True)
contour_spacing = Slider(100, range=0..1000)
len = Length(Curve=item)
end = EndPoints(Curve=crv)  # -> Start, End
Z = UnitZ(Factor=len)
Y = UnitY(Factor=len)
pt = Point(end.End)
item_2 = ListItem(List=pt, Index=Slider(0, range=0..100), Wrap=True)
pt_2 = Point(item_2)
contour = Contour(Shape=bbox.Box, Point=pt_2, Direction=Y, Distance=contour_spacing)  # -> flatten(Contours)
contour_2 = Contour(Shape=bbox.Box, Point=pt_2, Direction=Z, Distance=contour_spacing)  # -> simplify(flatten(Contours))
crv_2 = Curve(contour)
crv_3 = Curve(contour_2)
item_3 = ListItem(List=crv_2, Index=Slider(25, range=0..100), Wrap=True)
toggle = BooleanToggle(True)
item_4 = ListItem(List=crv_3, Index=Slider(29, range=0..100), Wrap=toggle)
item_5 = ListItem(List=crv_3, Index=Slider(24, range=0..100), Wrap=toggle)
item_6 = ListItem(List=crv_2, Index=Slider(31, range=0..100), Wrap=True)
crv_4 = Curve(item_4)
crv_5 = Curve(item_5)
crv_6 = Curve(item_3)
crv_7 = Curve(item_6)
flip = FlipCurve(Curve=crv_4)  # -> Curve, Flag
flip_2 = FlipCurve(Curve=crv_6)  # -> Curve, Flag
flip_3 = FlipCurve(Curve=crv_5)  # -> Curve, Flag
flip_4 = FlipCurve(Curve=crv_7)  # -> Curve, Flag
crvprox = CurveProximity(CurveA=flip_3.Curve, CurveB=flip_2.Curve)  # -> PointA, PointB, Distance
crvprox_2 = CurveProximity(CurveA=flip_3.Curve, CurveB=flip_4.Curve)  # -> PointA, PointB, Distance
crvprox_3 = CurveProximity(CurveA=flip.Curve, CurveB=flip_2.Curve)  # -> PointA, PointB, Distance
crvprox_4 = CurveProximity(CurveA=flip.Curve, CurveB=flip_4.Curve)  # -> PointA, PointB, Distance
sort = SortList(Keys=len)  # -> reverse(Keys), ValuesA
ln = Line(StartPoint=crvprox_2.PointA, EndPoint=crvprox_4.PointA)
ln_2 = Line(StartPoint=crvprox_4.PointA, EndPoint=crvprox_3.PointA)
ln_3 = Line(StartPoint=crvprox_3.PointA, EndPoint=crvprox.PointA)
item_7 = ListItem(List=sort.Keys, Index=0, Wrap=True)
ln_4 = Line(StartPoint=crvprox.PointA, EndPoint=crvprox_2.PointA)
X = UnitX(Factor=item_7)
join = JoinCurves(Curves=[ln_4, ln_3, ln_2, ln], Preserve=False)
extr = Extrude(Base=join, Direction=X)
cap = CapHoles(Brep=extr)
mesh_2 = MeshBrep(
    Brep=cap,
    Settings={GridMaxCount=0, GridMinCount=16, JaggedSeams=False, MaxEdgeLength=0, MinEdgeLength=0.0001, MinTolerance=0, Refine=True, RefineAngle=0, RelativeTolerance=0.65, SimplePlanes=True, Tolerance=0})
mint = MeshIntersection(MeshesA=mesh_2, MeshesB=mesh)
