# Grasshopper definition NEG SPACE.gh (Grasshopper 1.0.7)
# plug-ins: Weaverbird

# ----
# Isolate Negative Space and Create Mesh
mesh = Mesh(<mesh referenced from the Rhino model>)
wbjoin = WeaverbirdsJoinMeshesAndWeld(Mesh=mesh, Weld=True)
wbunify = WeaverbirdsUnifyFaceWindings(MeshCurves=wbjoin)
bbox = BoundingBox(Content=wbunify, Plane=PlaneXY(0, 0, 0))  # -> Box, Box_2
smesh = SimpleMesh(Brep=bbox.Box)
volume = Volume(Geometry=smesh)  # -> Volume, Centroid
mesh_2 = Mesh(wbunify)
volume_2 = Volume(Geometry=mesh_2)  # -> Volume, Centroid
scale = Scale(Geometry=smesh, Center=volume.Centroid, Factor=Slider(0.999, range=0..1))  # -> Geometry, Transform
mdif = MeshDifference(MeshesA=scale.Geometry, MeshesB=wbunify)
wbfacepolys = WeaverbirdsFacePolylines(Mesh=mdif)
