# Grasshopper definition SolarOutput_CNY.gh (Grasshopper 1.0.5)

pvgen = Honeybee_Generator_PV()  # -> readMe, PV_HBSurfaces; plug-in component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
simplifiedphotovoltaicsmodule = Ladybug_SimplifiedPhotovoltaicsModule(mountType=1, moduleEfficiency=15, temperatureCoefficient=-0.5, moduleActiveAreaPercent=90)  # -> readMe, PVmoduleSettings; plug-in component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
viewrose = Ladybug_viewRose()  # -> readMe, viewRose, blocked, visibleAngle; plug-in component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
genmesh = Ladybug_GenerateMesh(moveTestMesh=True)  # -> readMe, simplify(testPoints), simplify(ptsVectors), simplify(facesArea), simplify(mesh); plug-in component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

# ----
# difference in actual and nameplate efficacy of panels
dctoacderatefactor = Ladybug_DCToACDerateFactor(
    annualShading=0,
    age=0,
    snow=0,
    wiring=2,
    soiling=2,
    mismatch=2,
    availability=3,
    connections=0.5,
    nameplateRating=1,
    lightInducedDegradation=1.5)  # -> readMe, totalLosses, DCtoACderateFactor; plug-in component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

ladybug = Ladybug_Ladybug()  # -> Vviiiiiiiiiizzz; plug-in component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

brep = Brep(<brep referenced from the Rhino model>)
path = FilePath("F:\PM\DME\ACTIVE\EPW\USA_NY_New.York-Central.Park.725033_TMY3.epw")
debrep = DeconstructBrep(Brep=brep)  # -> Faces, Edges, Vertices
simplifiedphotovoltaicsmodule_2 = Ladybug_SimplifiedPhotovoltaicsModule(
    mountType=Slider(2, range=0..10),
    moduleEfficiency=Slider(19.3, range=0..100),
    temperatureCoefficient="-0.40%/°C",
    moduleActiveAreaPercent=Slider(90, range=0..100))  # -> readMe, PVmoduleSettings; plug-in component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
photovoltaicssurface = Ladybug_PhotovoltaicsSurface(
    epwFile=path,
    PVsurface=graft(debrep.Faces),
    PVsurfacePercent=Slider(100, range=0..100),
    DCtoACderateFactor=0.85,
    PVmoduleSettings=simplifiedphotovoltaicsmodule_2.PVmoduleSettings,
    north=0,
    runIt=Toggle(True))  # -> readMe, port, ACenergyPerHour, ACenergyPerYear, averageDailyACenergyPerYear, port_2, DCenergyPerHour, totalRadiationPerHour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; plug-in component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
panel = Panel(photovoltaicssurface.ACenergyPerHour)

panel_2 = Panel(simplifiedphotovoltaicsmodule_2.readMe)
range = Range(Domain="0 to 500", Steps=Slider(200, range=0..1000))
list_item = ListItem(List=panel, Index=range, Wrap=True)
python = GhPythonScript(x=list_item)  # -> out, a
# ---------- python: Python ----------
import rhinoscriptsyntax as rs

for i in x:
    if "key" in x:
        break
    if "(" in x:
        break
    if "AC" in x:
        break
    else:
        y = float(x)
        a = y * 1000
# ---------- end python ----------
python_script = PythonScript(x=python.a)  # -> out, a
# ---------- python_script: Python ----------
import rhinoscriptsyntax as rs

y = str(x)
a = y + " KwH"
# ---------- end python_script ----------
python_2 = GhPythonScript(x=python_script.a)  # -> out, a
# ---------- python_2: Python ----------
import rhinoscriptsyntax as rs
for i in x:
    if "None" in x:
        break
    if x == "0.0 KwH" or x == "":
        break
    
    else:
        a = x
# ---------- end python_2 ----------
python_3 = GhPythonScript(x=python_2.a)  # -> out, a
# ---------- python_3: Python ----------
import rhinoscriptsyntax as rs

list = []
list.append(x)

for i in list:
    if i == "": 
       list.remove(i)
    else:
        a = list
# ---------- end python_3 ----------
panel_3 = Panel(python_2.a)
