# Grasshopper definition Sun Intensity Map_20190311.gh (Grasshopper 1.0.7)

face_boundaries = FaceBoundaries()  # -> graft(Boundaries)
boundary_surfaces = BoundarySurfaces()
faceb = FaceBoundaries()
list_item = ListItem(List=faceb, Index=Slider(1, range=0..1), Wrap=True)
get_individual_colors = GhPythonScript()  # -> out, a; inputs x: Color
# ---------- get_individual_colors: Python ----------
import rhinoscriptsyntax as rs

yellow1 = []
yellow2 = []
orange1 = []
orange2 = []
red1 = []
red2 = []
red3 = []
purple1 = []
purple2 = []
blue1 = []
blue2 = []

if x == "255,0,0":
    red2.append(x)
else if x == "":
    red3.append(x)

not in unique_cols:
    unique_cols.append(x)
# ---------- end get_individual_colors ----------
edge_surface = EdgeSurface(CurveA=list_item)

# ----
# Solar Intensity Re-Mapping
# Mapping data back to its related 3D model vertex
path = FilePath("C:\Users\pmama\Desktop\Sci-Arc Portfolio\DME\assets\code images\USA_NY_New.York-Central.Park.725033_TMY3.epw")
ladybug = Ladybug_Ladybug()  # -> Vviiiiiiiiiizzz; plug-in component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
importepw = Ladybug_ImportEpw(epwFile=path)  # -> readMe, latitude, location, dryBulbTemperature, dewPointTemperature, relativeHumidity, windSpeed, windDirection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; plug-in component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
panel = Panel(importepw.readMe)
series = Series(Start=Slider(1, range=0..10), Step=1, Count=Slider(24, range=0..100))
sunpath = Ladybug_SunPath(
    location=importepw.location,
    hour=series,
    day=Slider(31, range=0..100),
    month=Slider(9, range=0..100),
    timeStep=1,
    sunPathScale=Slider(0.03, range=0..1),
    dailyOrAnnualSunPath=True)  # -> readMe, sunVectors, sunAltitudes, sunAzimuths, port, sunSpheresMesh, sunPathCrvs, compassCrvs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; plug-in component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
brep = Brep(<brep referenced from the Rhino model>)
brep_2 = Brep(<brep referenced from the Rhino model>)
debrep = DeconstructBrep(Brep=brep)  # -> Faces, Edges, Vertices
flip = Flip(Surface=debrep.Faces)  # -> Surface, Result
toggle = BooleanToggle(True)
legendpar = Ladybug_LegendParameters(numSegments=Slider(20, range=0..100))  # -> legendPar; plug-in component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
sunlighthoursanalysis = Ladybug_SunlightHoursAnalysis(
    geometry=flatten(brep_2),
    context=flatten(flip.Surface),
    gridSize=Slider(0.08, range=-1..1),
    disFromBase=Slider(2, range=0..10),
    sunVectors=flatten(sunpath.sunVectors),
    timeStep=1,
    legendPar=flatten(legendpar),
    parallel=toggle,
    runIt=toggle)  # -> readMe, contextMesh, analysisMesh, testPts, testVec, port, sunlightHoursResult, sunlightHoursMesh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; plug-in component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
mesh = Mesh(sunlighthoursanalysis.sunlightHoursMesh)
mesh_2 = Mesh(<mesh referenced from the Rhino model>)
demesh = DeconstructMesh(Mesh=mesh)  # -> Vertices, Faces, Colours, Normals
demesh_2 = DeconstructMesh(Mesh=mesh_2)  # -> Vertices, Faces, Colours, Normals
area = Area(Geometry=mesh_2)  # -> Area, Centroid
pt = Point(area.Centroid)
pt_2 = Point(demesh_2.Vertices)
ln = Line(StartPoint=pt, EndPoint=pt_2)
col = Colour(demesh.Colours)
line = Line(ln)
scale = Scale(Geometry=line, Center=pt, Factor=Slider(2, range=0..10))  # -> Geometry, Transform
end = EndPoints(Curve=scale.Geometry)  # -> Start, End
tag = TextTag(Location=end.End, Text=col, Colour=col)
