# Grasshopper definition SunVector_Build_03272019.gh (Grasshopper 1.0.7)

path = FilePath("C:\Users\pmama\Desktop\Sci-Arc Portfolio\DME\assets\code images\USA_NY_New.York-Central.Park.725033_TMY3.epw")
importepw = Ladybug_ImportEpw(epwFile=path)  # -> readMe, latitude, location, dryBulbTemperature, dewPointTemperature, relativeHumidity, windSpeed, windDirection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; plug-in component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
ladybug = Ladybug_Ladybug()  # -> out; plug-in component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
number_slider = Slider(31, range=0..100)
series = Series(Start=Slider(1, range=0..10), Step=1, Count=Slider(24, range=1..25))
series_2 = Series(Start=Slider(1, range=0..10), Step=Slider(8, range=0..10), Count=Slider(7, range=0..100))
sunpath = Ladybug_SunPath(
    location=importepw.location,
    hour=series,
    day=series_2,
    month=Slider(9, range=0..100),
    timeStep=1,
    sunPathScale=Slider(0.03, range=0..1),
    dailyOrAnnualSunPath=True,
    bakeIt=Toggle(False))  # -> readMe, sunVectors, sunAltitudes, sunAzimuths, port, sunSpheresMesh, sunPathCrvs, compassCrvs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; plug-in component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

# ----
# Get Intersection Space - Object and the Sun Rays Passing Through It
# sun vector lines
# sun vector apex
# All Sun Vector End points
brep = Brep(<brep referenced from the Rhino model>)
deconstruct_brep = DeconstructBrep(Brep=brep)  # -> Faces, Edges, Vertices
list_item = ListItem(List=deconstruct_brep.Vertices, Index=Slider(2, range=0..10), Wrap=True)
list_item_2 = ListItem(List=deconstruct_brep.Vertices, Index=Slider(1, range=0..10), Wrap=True)
distance = Distance(PointA=list_item_2, PointB=list_item)
unit_x = UnitX(Factor=1)
line_sdl = LineSDL(Start=list_item_2, Direction=unit_x, Length=distance)
divide_curve = DivideCurve(Curve=line_sdl, Count=Slider(2, range=0..10), Kinks=False)  # -> Points, Tangents, Parameters
list_item_3 = ListItem(List=divide_curve.Points, Index=Slider(1, range=0..1), Wrap=True)
Y = UnitY(Factor=1)
pt = Point(list_item_3)
line = LineSDL(Start=pt, Direction=Y, Length=Slider(-2, range=-10..10))
move = Move(Geometry=pt, Motion=line)  # -> Geometry, Transform
Z = UnitZ(Factor=1)
line_2 = LineSDL(Start=move.Geometry, Direction=Z, Length=Slider(3.65, range=0..10))
move_2 = Move(Geometry=move.Geometry, Motion=line_2)  # -> Geometry, Transform
vec = Vector(sunpath.sunVectors)
sun = Sphere(Base=move_2.Geometry, Radius=Slider(0.2, range=0..1))
line_3 = LineSDL(Start=move_2.Geometry, Direction=vec, Length=Slider(100, range=0..100))
brep_2 = Brep(<brep referenced from the Rhino model>)
end_points = EndPoints(Curve=line_3)  # -> Start, End
debrep = DeconstructBrep(Brep=brep_2)  # -> Faces, Edges, Vertices
item = ListItem(List=debrep.Faces, Index=Slider(0, range=0..100), Wrap=True)
srf = Surface(item)
point = Point(end_points.End)
area = Area(Geometry=srf)  # -> Area, Centroid
ln = Line(StartPoint=move_2.Geometry, EndPoint=area.Centroid)
python = GhPythonScript(x=point)  # -> out, a, b; inputs x: Point3d
# ---------- python: Python ----------
import scriptcontext as sc
import rhinoscriptsyntax as rs
import Rhino 

y = "+"
sc.doc = Rhino.RhinoDoc.ActiveDoc
a = rs.AddText(y, x)
sc.doc = ghdoc
# ---------- end python ----------
scale = Scale(Geometry=srf, Center=area.Centroid, Factor=Slider(2.5, range=0..10))  # -> Geometry, Transform
line_4 = LineSDL(Start=area.Centroid, Direction=ln, Length=Slider(-6, range=-10..10))
move_3 = Move(Geometry=scale.Geometry, Motion=line_4)  # -> Geometry, Transform
area_2 = Area(Geometry=move_3.Geometry)  # -> Area, Centroid
ln_2 = Line(StartPoint=move_2.Geometry, EndPoint=area_2.Centroid)
pipe = Pipe(Curve=ln_2, Radius=Slider(0.003, range=0..0.01), Caps=0)

# ----
# CONTROL BOTTOM PLANE
# RH  end point
# end point plane
# LH  end point
number_slider_2 = Slider(24, range=0..100)
series_3 = Series(Start=number_slider_2, Step=Slider(1, range=0..1), Count=Slider(12, range=0..100))
item_2 = ListItem(List=point, Index=series_3, Wrap=True)
item_3 = ListItem(List=item_2, Index=Slider(14, range=0..30), Wrap=True)
item_4 = ListItem(List=item_2, Index=Slider(8, range=0..30), Wrap=True)

# ----
# CONTROL TOP PLANE
# RH  end point
# end point plane
# LH  end point
number_slider_3 = Slider(46, range=0..100)
series_4 = Series(Start=number_slider_3, Step=Slider(1, range=0..1), Count=Slider(12, range=0..100))
item_5 = ListItem(List=point, Index=series_4, Wrap=True)
item_6 = ListItem(List=item_5, Index=Slider(10, range=0..10), Wrap=True)
item_7 = ListItem(List=item_5, Index=Slider(15, range=0..20), Wrap=True)

fcircle = CircleFit(Points=item_5)  # -> Circle, Radius, Deviation
area_3 = Area(Geometry=fcircle.Circle)  # -> Area, Centroid
scale_2 = Scale(Geometry=fcircle.Circle, Center=area_3.Centroid, Factor=Slider(0.005, range=0..1))  # -> Geometry, Transform
pln = Plane(area_3.Centroid)
deplane = DeconstructPlane(Plane=pln)  # -> Origin, XAxis, YAxis, ZAxis
rotate = Rotate(Angle=Slider(90, range=0..100), Plane=pln)  # -> Geometry, Transform
area_4 = Area(Geometry=rotate.Geometry)  # -> Area, Centroid

# ----
# sun vector brep starting point (rail 2 in sweep2 for face)
number_slider_4 = Slider(-0.05, range=-10..10)
X = UnitX(Factor=1)
line_5 = LineSDL(Start=move_2.Geometry, Direction=X, Length=number_slider_4)
line_6 = LineSDL(Start=move_2.Geometry, Direction=X, Length=Slider(0.05, range=-10..10))
move_4 = Move(Geometry=move_2.Geometry, Motion=line_5)  # -> Geometry, Transform
move_5 = Move(Geometry=move_2.Geometry, Motion=line_6)  # -> Geometry, Transform
ln_3 = Line(StartPoint=move_4.Geometry, EndPoint=move_5.Geometry)

# ----
# top face
ln_4 = Line(StartPoint=move_2.Geometry, EndPoint=item_6)
ln_5 = Line(StartPoint=item_6, EndPoint=item_7)
swp2 = Sweep2(Rail1=ln_5, Rail2=ln_3, Sections=ln_4, SameHeight=False)

# ----
# negative space
brep_3 = Brep(<brep referenced from the Rhino model>)
cap = CapHoles(Brep=brep_3)
bbox = BoundingBox(Content=brep_3, Plane=PlaneXY(0, 0, 0))  # -> Box, Box_2
volume = Volume(Geometry=brep)  # -> Volume, Centroid
scale_3 = Scale(Geometry=brep, Center=volume.Centroid, Factor=Slider(0.999, range=0..1))  # -> Geometry, Transform
sdiff = SolidDifference(BrepsA=scale_3.Geometry, BrepsB=cap)

# ----
# end face
# end points
# top {
# bottom {
pt_2 = Point(item_3)
pt_3 = Point(item_4)
pt_4 = Point(item_6)
pt_5 = Point(item_7)
ln_6 = Line(StartPoint=pt_5, EndPoint=pt_2)
ln_7 = Line(StartPoint=pt_4, EndPoint=pt_5)
ln_8 = Line(StartPoint=pt_2, EndPoint=pt_3)
ln_9 = Line(StartPoint=pt_4, EndPoint=pt_3)
swp2_2 = Sweep2(Rail1=ln_6, Rail2=ln_9, Sections=ln_7, SameHeight=False)

# ----
# bottom face
ln_10 = Line(StartPoint=move_2.Geometry, EndPoint=item_4)
ln_11 = Line(StartPoint=item_4, EndPoint=item_3)
swp2_3 = Sweep2(Rail1=ln_11, Rail2=ln_3, Sections=ln_10, SameHeight=False)

# ----
# sun vector brep
join = BrepJoin(Breps=[swp2_3, swp2, swp2_2])  # -> Breps, Closed
capex = CapHolesEx(Brep=join.Breps)  # -> Brep, Caps, Solid

# ----
# negative space
brep_4 = Brep(sdiff)

# ----
# INTERSECTION RESULT
sint = SolidIntersection(BrepsA=capex.Brep, BrepsB=brep_4)
