# Grasshopper definition point_to_meshsphere_colored.gh (Grasshopper 1.0.7)

# ----
# Sample and Re-color Mesh With Environmental Data
# - Heat
# - Water
# - Rust
# - Wind
# - Solar Energy
number_slider = Slider(0.22, range=0..1)
pt = Point(<point referenced from the Rhino model>)
msphere = MeshSphere(Base=pt, Radius=number_slider, UCount=10, VCount=20)
point_color = GhPythonScript(x=pt)  # -> out, a; inputs x: Guid
# ---------- point_color: Python ----------
__author__ = "pmama"
__version__ = "2019.03.28"

import rhinoscriptsyntax as rs
from Rhino.RhinoDoc import ActiveDoc as rhdoc
import scriptcontext as sc
sc.doc = rhdoc


a = rs.ObjectColor(x)

sc.doc = ghdoc
# ---------- end point_color ----------
mesh = Mesh(msphere)
col = Colour(point_color.a)
mcol = MeshColours(Mesh=graft(mesh), Colours=graft(col))
texture_maker = Ladybug_TextureMaker(analysisMesh=flatten(mcol), layerName="baked mesh textures", bakeIt=Toggle(False))  # -> readMe, imagePath, alphaPath, mesh; plug-in component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
mesh_2 = Mesh(texture_maker.mesh)
